# Grasshopper definition make_sample_model.gh (Grasshopper 1.0.7)

rectangle = Rectangle(Plane=PlaneXY(0, 0, 0), XSize="44", YSize="24", Radius=0)  # -> Rectangle, Length
x方向スパン数 = Slider(4, range=0..20)
y方向スパン数 = Slider(3, range=0..20)
deconstruct_brep = DeconstructBrep(Brep=rectangle.Rectangle)  # -> Faces, Edges, Vertices
divide_curve = DivideCurve(Curve=deconstruct_brep.Edges, Count=y方向スパン数, Kinks=False)  # -> Points, Tangents, Parameters
divide_curve_2 = DivideCurve(Curve=deconstruct_brep.Edges, Count=x方向スパン数, Kinks=False)  # -> Points, Tangents, Parameters
explode_tree = ExplodeTree(Data=divide_curve.Points)  # -> Branch0, Branch1, Branch2, Branch3
explode_tree_2 = ExplodeTree(Data=divide_curve_2.Points)  # -> Branch0, Branch1, Branch2, Branch3
reverse_list = ReverseList(List=explode_tree.Branch3)
reverse_list_2 = ReverseList(List=explode_tree_2.Branch2)
line = Line(StartPoint=explode_tree_2.Branch0, EndPoint=reverse_list_2)
line_2 = Line(StartPoint=explode_tree.Branch1, EndPoint=reverse_list)
divide_curve_3 = DivideCurve(Curve=line, Count=y方向スパン数, Kinks=False)  # -> Points, Tangents, Parameters
panel = Panel("""4.5
9
13.5
18
22.5
27
31.5
35""")
divide_curve_4 = DivideCurve(Curve=line_2, Count=x方向スパン数, Kinks=False)  # -> flatten(Points), Tangents, Parameters
explode_tree_3 = ExplodeTree(Data=divide_curve_3.Parameters)  # -> _0000, _0001
shatter = Shatter(Curve=line, Parameters=explode_tree_3._0000)
explode_tree_4 = ExplodeTree(Data=divide_curve_4.Parameters)  # -> _0010, _0011
shatter_2 = Shatter(Curve=line_2, Parameters=explode_tree_4._0010)
list_length = ListLength(List=panel)
expression = Expression(x=list_length, Expression="x-1")
unit_z = UnitZ(Factor=panel)
list_item = ListItem(List=panel, Index=expression, Wrap=True)
vector_xyz = VectorXYZ(XComponent=0, YComponent=0, ZComponent=unit_z)  # -> graft(Vector), Length
unit_z_2 = UnitZ(Factor=1)
move = Move(Geometry=flatten([shatter, shatter_2]), Motion=vector_xyz.Vector)  # -> Geometry, Transform
move_2 = Move(Geometry=flatten(divide_curve_4.Points), Motion=vector_xyz.Vector)  # -> Geometry, Transform
line_sdl = LineSDL(Start=divide_curve_4.Points, Direction=unit_z_2, Length=list_item)
line_3 = Line(flatten([shatter, shatter_2, move.Geometry]))
divide_length = DivideLength(Curve=line_sdl, Length=panel)  # -> Points, Tangents, Parameters
explode_tree_5 = ExplodeTree(Data=divide_length.Parameters)  # -> Branch0, Branch1
shatter_3 = Shatter(Curve=graft(line_sdl), Parameters=flatten(explode_tree_5.Branch0))  # -> flatten(Segments)
curve_middle = CurveMiddle(Curve=line_3)
merge = Merge(Data1=divide_curve_4.Points, Data2=move_2.Geometry)  # -> flatten(Result)
plane_origin = PlaneOrigin()
curve_middle_2 = CurveMiddle(Curve=shatter_3)
colour_picker = ColourPicker(PickedColour=RGB(32, 42, 43))
ghpython_script = GhPythonScript(
    columns=flatten(shatter_3),
    beams=flatten(line_3),
    node=flatten(merge),
    layer=panel,
    x_length="44",
    y_length="24",
    Toggle=Button())  # -> out, beam_no, column_no, node_no, beam_H, beam_B, column_H, column_t, beam_info, column_info; inputs columns: list, beams: list, node: list, layer: list
# ---------- ghpython_script: Python ----------
__author__ = "fujishita"
__version__ = "2023.12.07"

import rhinoscriptsyntax as rs
import csv

#節点座標を抽出
temp=0
node_no = [];node_x = [];node_y = [];node_z = []
for point in node:
    temp += 1
    point_coord = rs.PointCoordinates(point)
    node_no.append(temp)
    node_x.append(float(point_coord[0]))
    node_y.append(float(point_coord[1]))
    node_z.append(float(point_coord[2]))
    
#柱部材の端部座標を抽出
beam_no = []; beam_start_No = []; beam_end_No = []; beam_category = []
beam_start_x = []; beam_start_y = []; beam_start_z = []
beam_end_x = []; beam_end_y = []; beam_end_z = []
layer_number = []; belong_height = []
temp = 0
layer.insert(0,0)

for i in beams:
    temp += 1
    #曲線の端点座標を抽出
    beam_start_point = rs.CurveStartPoint(i)
    beam_end_point = rs.CurveEndPoint(i)
    beam_no.append(temp)
    beam_start_x.append(beam_start_point[0])
    beam_start_y.append(beam_start_point[1])
    beam_start_z.append(beam_start_point[2])
    beam_end_x.append(beam_end_point[0])
    beam_end_y.append(beam_end_point[1])
    beam_end_z.append(beam_end_point[2])
        
    if float(beam_start_point[2]) == float(0):
        beam_category.append('BB')
    else:
        beam_category.append('')
    
    #始点の節点番号を抽出
    frag = 0
    for j in range(len(node)):
        if float(round(beam_start_point[0],1)) == float(round(node_x[j],1)) and float(round(beam_start_point[1],1)) == float(round(node_y[j],1)) and float(round(beam_start_point[2],1)) == float(round(node_z[j],1)):
            beam_start_No.append(node_no[j])
            frag = 1
    if frag == 0:
        beam_start_No.append("")
    
    frag = 0
    #終点の節点番号を抽出
    for j in range(len(node)):
        if float(round(beam_end_point[0],1)) == float(round(node_x[j],1)) and float(round(beam_end_point[1],1)) == float(round(node_y[j],1)) and float(round(beam_end_point[2],1)) == float(round(node_z[j],1)):
            beam_end_No.append(node_no[j])
            frag = 1
    if frag == 0:
        beam_end_No.append("")
            
print(len(beams),len(beam_no),len(beam_start_No),len(beam_end_No))
    
#梁部材の端部座標を抽出
column_no = [];column_start_No = []; column_end_No = []
column_start_x = []; column_start_y = []; column_start_z = []
column_end_x = []; column_end_y = []; column_end_z = []
temp = 0
for i in columns:
    temp += 1
    #曲線の端点座標を抽出
    column_start_point = rs.CurveStartPoint(i)
    column_end_point = rs.CurveEndPoint(i)
    column_no.append(temp)
    column_start_x.append(column_start_point[0])
    column_start_y.append(column_start_point[1])
    column_start_z.append(column_start_point[2])
    column_end_x.append(column_end_point[0])
    column_end_y.append(column_end_point[1])
    column_end_z.append(column_end_point[2])
    
    #所属層の判定
    belong_height = (column_start_z[temp-1]+column_end_z[temp-1])/2
    temp2 = 0
    for j in layer: 
        if belong_height < j:
            layer_number.append(temp2)
            break
        temp2 += 1
    
    #始点の節点番号を抽出
    frag = 0
    for j in range(len(node)):
        if float(round(column_start_point[0],1)) == float(round(node_x[j],1)) and float(round(column_start_point[1],1)) == float(round(node_y[j],1)) and float(round(column_start_point[2],1)) == float(round(node_z[j],1)):
            column_start_No.append(node_no[j])
            frag = 1
    if frag == 0:
        column_start_No.append("")
    
    #終点の節点番号を抽出
    frag = 0
    for j in range(len(node)):
        if float(round(column_end_point[0],1) == float(round(node_x[j],1)) and float(round(column_end_point[1],1)) == float(round(node_y[j],1)) and float(round(column_end_point[2],1)) == float(round(node_z[j],1))):
            column_end_No.append(node_no[j])
            frag = 1
    if frag == 0:
        column_end_No.append("")
            
print(len(columns),len(column_no),len(column_start_No),len(column_end_No))
    
#csv出力
file_path = "E:\鹿島意匠\Initial_Section_Study\make_sample_model\output_node.csv"
with open(file_path, mode='w') as file:
    writer = csv.writer(file, lineterminator="\n")
    
    # データをCSVファイルに書き込む
    writer.writerow(['No','x','y','z','boundary'])
    for i in range(len(node)):
        writer.writerow([node_no[i],node_x[i],node_y[i],node_z[i],''])

file_path = "E:\鹿島意匠\Initial_Section_Study\make_sample_model\output_beams.csv"
with open(file_path, mode='w') as file:
    writer = csv.writer(file, lineterminator="\n")
    
    # データをCSVファイルに書き込む
    writer.writerow(['No.','i_point','j_point','phai','C','M','Q','category'])
    for i in range(len(beams)):
        writer.writerow([beam_no[i],beam_start_No[i],beam_end_No[i],1.2,35.8,53.7,38,beam_category[i]])

file_path = "E:\鹿島意匠\Initial_Section_Study\make_sample_model\output_columns.csv"
with open(file_path, mode='w') as file:
    writer = csv.writer(file, lineterminator="\n")
    
    # データをCSVファイルに書き込む
    writer.writerow(['No.','i_point','j_point','story'])
    for i in range(len(columns)):
        writer.writerow([column_no[i],column_start_No[i],column_end_No[i],layer_number[i]])
        
file_path = "E:\鹿島意匠\Initial_Section_Study\make_sample_model\output_layer.csv"
with open(file_path, mode='w') as file:
    writer = csv.writer(file, lineterminator="\n")
    
    # データをCSVファイルに書き込む
    writer.writerow(['Story','Story_height','omega_1','omega_2','floor_area'])
    print(layer)
    for i in range(len(layer)-1):
        temp = len(layer) - i-1
        layer_height = layer[len(layer)-i-1]-layer[len(layer)-i-2]
        writer.writerow([temp,layer_height,5.5,150,x_length*y_length])

#出力断面の読み込み
file_path = "E:\鹿島意匠\Initial_Section_Study\output_section_cost.csv"
record1 = [] ; record2 = []
with open(file_path, mode='r') as csvfile:
    # CSVリーダーオブジェクトを作成
    csv_reader = csv.reader(csvfile)
    # 行ごとに処理
    for row in csv_reader:
        # 行の内容を表示（例：各列の値を出力）
        if row[0] == '<selected_beam_section>':
            count = 1
        if count == 1:
            record1.append(row[0:5])
        if row[0] == '<selected_column_section>':
            count = 2
        if count == 2:
            record2.append(row[0:5])

beam_H=[];beam_B=[];beam_info=[]
column_H=[];column_t=[];column_info=[]
for i in range(2,len(record1)-1):
    temp=record1[i]
    if temp[1] == "[]":
        beam_H.append(0)
        beam_B.append(0)
        beam_info.append('')
    else:
        beam_H.append(float(temp[1])/1000)
        beam_B.append(float(temp[2])/1000)
        beam_info.append('H-'+str(temp[1])+'×'+str(temp[2]))

for i in range(2,len(record2)-1):
    temp2 = record2[i]
    column_H.append(float(temp2[1])/1000)
    column_t.append(float(temp2[2])/1000)
    column_info.append('□-'+str(temp2[1])+'×'+str(temp2[2]))
# ---------- end ghpython_script ----------
colour_picker_2 = ColourPicker(PickedColour=RGB(188, 227, 34))
text_tag_3d = TextTag3D(Location=curve_middle, Text=ghpython_script.beam_no, Size="0.5", Colour=colour_picker, Justification=7)
text_tag_3d_2 = TextTag3D(Location=curve_middle_2, Text=ghpython_script.column_no, Size="0.5", Colour=colour_picker_2, Justification=7)
colour_picker_3 = ColourPicker(PickedColour=RGB(217, 137, 137))
text_tag_3d_3 = TextTag3D(Location=merge, Text=ghpython_script.node_no, Size="0.5", Colour=colour_picker_3, Justification=7)
cluster = Cluster(
    location=curve_middle,
    text=ghpython_script.beam_info,
    curve=line_3,
    radius=ghpython_script.beam_H,
    curve_2=shatter_3,
    radius_2=ghpython_script.column_H,
    location_2=curve_middle_2,
    text_2=ghpython_script.column_info)

# ==== cluster Cluster
colour_picker = ColourPicker(PickedColour=RGB(245, 218, 47))
colour_picker_2 = ColourPicker(PickedColour=RGB(31, 204, 187))
location = ClusterInput()
text = ClusterInput()
curve = ClusterInput()
radius = ClusterInput()
curve_2 = ClusterInput()
radius_2 = ClusterInput()
location_2 = ClusterInput()
text_2 = ClusterInput()
text_tag_3d = TextTag3D(Location=location, Text=text, Size="0.4", Colour=colour_picker, Justification="2")
pipe = Pipe(Curve=curve, Radius=radius, Caps=0)
pipe_2 = Pipe(Curve=curve_2, Radius=radius_2, Caps=0)
text_tag_3d_2 = TextTag3D(Location=location_2, Text=text_2, Size="0.4", Colour=colour_picker_2, Justification="2")
