# Grasshopper definition make_sample_model_rev3.gh (Grasshopper 1.0.7)

xdirection = Panel("1")
xdirection_2 = Panel("1")
xdirection_3 = Panel("1")
ydirection = Panel("""0
6
13.7
21.4
29.1""")
ydirection_2 = Panel("""0
5.64
11.34
17.04
22.68""")
xdirection_4 = Panel("""0
7.2
14.4
17.4""")
xdirection_5 = Panel("""0
7.2
14.4
17.4""")
list_length = ListLength(List=xdirection_5)
subtraction = Subtraction(A=list_length, B=xdirection)
list_item = ListItem(List=xdirection_5, Index=subtraction, Wrap=True)
unit_x = UnitX(Factor=list_item)
ydirection_3 = Panel("""0
6
13.7
21.4
29.1""")
list_length_2 = ListLength(List=ydirection_3)
subtraction_2 = Subtraction(A=list_length_2, B=xdirection_2)
list_item_2 = ListItem(List=ydirection_3, Index=subtraction_2, Wrap=True)
xdirection_6 = Panel("0")
ydirection_4 = Panel("0")
unit_y = UnitY(Factor=list_item_2)
list_length_3 = ListLength(List=xdirection_5)
list_length_4 = ListLength(List=ydirection_3)
subtraction_3 = Subtraction(A=list_length_3, B=xdirection_3)
subtraction_4 = Subtraction(A=list_length_4, B=xdirection_3)
unit_z = UnitZ(Factor=1)
list_item_3 = ListItem(List=xdirection_5, Index=subtraction_3, Wrap=True)
list_item_4 = ListItem(List=ydirection_3, Index=subtraction_4, Wrap=True)
construct_point = ConstructPoint(XCoordinate=ydirection_4, YCoordinate=ydirection_3, ZCoordinate=xdirection_6)
list_length_5 = ListLength(List=construct_point)
subtraction_5 = Subtraction(A=list_length_5, B="1")
list_item_5 = ListItem(List=construct_point, Index=subtraction_5, Wrap=True)
list_item_6 = ListItem(List=construct_point, Index=0, Wrap=True)
line = Line(StartPoint=list_item_6, EndPoint=list_item_5)
move = Move(Geometry=line, Motion=unit_x)  # -> Geometry, Transform
unit_y_2 = UnitY(Factor=list_item_4)
unit_x_2 = UnitX(Factor=list_item_3)
construct_point_2 = ConstructPoint(XCoordinate=xdirection_5, YCoordinate=ydirection_4, ZCoordinate=xdirection_6)
list_length_6 = ListLength(List=construct_point_2)
subtraction_6 = Subtraction(A=list_length_6, B="1")
list_item_7 = ListItem(List=construct_point_2, Index=0, Wrap=True)
list_item_8 = ListItem(List=construct_point_2, Index=subtraction_6, Wrap=True)
line_2 = Line(StartPoint=list_item_7, EndPoint=list_item_8)
move_2 = Move(Geometry=line_2, Motion=unit_y)  # -> Geometry, Transform
line_3 = Line([line, move.Geometry, line_2, move_2.Geometry])
extrude = Extrude(Base=line_3, Direction=unit_z)
move_3 = Move(Geometry=construct_point_2, Motion=unit_y_2)  # -> Geometry, Transform
move_4 = Move(Geometry=construct_point, Motion=unit_x_2)  # -> Geometry, Transform
rectangle = Rectangle(Plane=PlaneXY(0, 0, 0), XSize="44", YSize="24", Radius=0)  # -> Rectangle, Length
y方向スパン数 = Slider(2, range=0..20)
x方向スパン数 = Slider(11, range=0..20)
line_4 = Line(StartPoint=construct_point_2, EndPoint=move_3.Geometry)
line_5 = Line(StartPoint=construct_point, EndPoint=move_4.Geometry)
deconstruct_brep = DeconstructBrep(Brep=rectangle.Rectangle)  # -> Faces, Edges, Vertices
multiple_curves = MultipleCurves(Curves=[line_4, line_5])  # -> Points, IndexA, IndexB, ParamA, ParamB
set_intersection = SetIntersection(SetA=multiple_curves.ParamA, SetB=multiple_curves.ParamA)
divide_curve = DivideCurve(Curve=deconstruct_brep.Edges, Count=x方向スパン数, Kinks=False)  # -> Points, Tangents, Parameters
set_intersection_2 = SetIntersection(SetA=multiple_curves.ParamB, SetB=multiple_curves.ParamB)
divide_curve_2 = DivideCurve(Curve=deconstruct_brep.Edges, Count=y方向スパン数, Kinks=False)  # -> Points, Tangents, Parameters
shatter = Shatter(Curve=line_4, Parameters=set_intersection)
shatter_2 = Shatter(Curve=line_5, Parameters=set_intersection_2)
explode_tree = ExplodeTree(Data=divide_curve_2.Points)  # -> Branch0, Branch1, Branch2, Branch3
explode_tree_2 = ExplodeTree(Data=divide_curve.Points)  # -> Branch0, Branch1, Branch2, Branch3
line_6 = Line(flatten([shatter, shatter_2]))
brep_curve = BrepCurve(Brep=graft(extrude), Curve=line_6)  # -> flatten(Curves), Points
reverse_list = ReverseList(List=explode_tree_2.Branch2)
reverse_list_2 = ReverseList(List=explode_tree.Branch3)
point = Point(multiple_curves.Points)
line_7 = Line(StartPoint=explode_tree_2.Branch0, EndPoint=reverse_list)
line_8 = Line(StartPoint=explode_tree.Branch1, EndPoint=reverse_list_2)
divide_curve_3 = DivideCurve(Curve=line_8, Count=x方向スパン数, Kinks=False)  # -> flatten(Points), Tangents, Parameters
panel = Panel("""4.5
9
13.5
18
22.5
27
31.5
35""")
unit_z_2 = UnitZ(Factor=panel)
move_5 = Move(Geometry=brep_curve.Curves, Motion=graft(unit_z_2))  # -> Geometry, Transform
line_9 = Line([brep_curve.Curves, move_5.Geometry])
panel_2 = Panel(line_9)
divide_curve_4 = DivideCurve(Curve=line_7, Count=y方向スパン数, Kinks=False)  # -> Points, Tangents, Parameters
explode_tree_3 = ExplodeTree(Data=divide_curve_4.Parameters)  # -> _0000, _0001
list_length_7 = ListLength(List=panel)
shatter_3 = Shatter(Curve=line_7, Parameters=explode_tree_3._0000)
explode_tree_4 = ExplodeTree(Data=divide_curve_3.Parameters)  # -> _0010, _0011
shatter_4 = Shatter(Curve=line_8, Parameters=explode_tree_4._0010)
expression = Expression(x=list_length_7, Expression="x-1")
unit_z_3 = UnitZ(Factor=panel)
list_item_9 = ListItem(List=panel, Index=expression, Wrap=True)
vector_xyz = VectorXYZ(XComponent=0, YComponent=0, ZComponent=unit_z_3)  # -> graft(Vector), Length
move_6 = Move(Geometry=line_6, Motion=vector_xyz.Vector)  # -> Geometry, Transform
move_7 = Move(Geometry=point, Motion=vector_xyz.Vector)  # -> Geometry, Transform
beams = Line(flatten([move_6.Geometry, line_6]))
point_2 = Point(flatten([point, move_7.Geometry]))
unit_z_4 = UnitZ(Factor=1)
line_sdl = LineSDL(Start=point, Direction=unit_z_4, Length=list_item_9)
list_item_10 = ListItem(List=line_sdl, Index=0, Wrap=True)
divide_length = DivideLength(Curve=list_item_10, Length=panel)  # -> Points, Tangents, Parameters
move_8 = Move(Geometry=flatten([shatter_3, shatter_4]), Motion=vector_xyz.Vector)  # -> Geometry, Transform
move_9 = Move(Geometry=flatten(divide_curve_3.Points), Motion=vector_xyz.Vector)  # -> Geometry, Transform
line_sdl_2 = LineSDL(Start=divide_curve_3.Points, Direction=unit_z_4, Length=list_item_9)
explode_tree_5 = ExplodeTree(Data=divide_length.Parameters)  # -> Branch0, Branch1, Branch2, Branch3, Branch4, Branch5, Branch6, Branch7, Branch8, Branch9
line_10 = Line(flatten([shatter_3, shatter_4, move_8.Geometry]))
divide_length_2 = DivideLength(Curve=line_sdl_2, Length=panel)  # -> Points, Tangents, Parameters
list_item_11 = ListItem(List=explode_tree_5.Branch6, Index="1", Wrap=True)
list_item_12 = ListItem(List=explode_tree_5.Branch0, Index="1", Wrap=True)
list_item_13 = ListItem(List=explode_tree_5.Branch1, Index="1", Wrap=True)
list_item_14 = ListItem(List=explode_tree_5.Branch2, Index="1", Wrap=True)
list_item_15 = ListItem(List=explode_tree_5.Branch3, Index="1", Wrap=True)
list_item_16 = ListItem(List=explode_tree_5.Branch5, Index="1", Wrap=True)
list_item_17 = ListItem(List=explode_tree_5.Branch4, Index="1", Wrap=True)
explode_tree_6 = ExplodeTree(Data=divide_length_2.Parameters)  # -> Branch0, Branch1
shatter_5 = Shatter(Curve=graft(line_sdl_2), Parameters=flatten(explode_tree_6.Branch0))  # -> flatten(Segments)
merge = Merge(
    Data1=list_item_12,
    Data2=list_item_13,
    Data3=list_item_14,
    Data4=list_item_15,
    Data5=list_item_17,
    Data6=list_item_16,
    Data7=list_item_11)  # -> flatten(Result)
shatter_6 = Shatter(Curve=graft(line_sdl), Parameters=flatten(merge))  # -> flatten(Segments)
curve_middle = CurveMiddle(Curve=line_10)
beam = Curve([<curve referenced from the Rhino model> x216])
column = Curve([<curve referenced from the Rhino model> x125])
merge_2 = Merge(Data1=divide_curve_3.Points, Data2=move_9.Geometry)  # -> flatten(Result)
end_points = EndPoints(Curve=column)  # -> Start, End
end_points_2 = EndPoints(Curve=beam)  # -> Start, End
curve_middle_2 = CurveMiddle(Curve=beam)
plane_origin = PlaneOrigin()
curve_middle_3 = CurveMiddle(Curve=shatter_5)
colour_picker = ColourPicker(PickedColour=RGB(32, 42, 43))
point_3 = Point([end_points.Start, end_points.End, end_points_2.Start, end_points_2.End])
ghpython_script = GhPythonScript(
    columns=flatten(shatter_5),
    beams=flatten(line_10),
    node=flatten(merge_2),
    layer=panel,
    x_length="44",
    y_length="24",
    Toggle=Button())  # -> out, beam_no, column_no, node_no, beam_H, beam_B, column_H, column_t, beam_info, column_info; inputs columns: list, beams: list, node: list, layer: list; disabled
# ---------- ghpython_script: Python ----------
__author__ = "fujishita"
__version__ = "2023.12.07"

import rhinoscriptsyntax as rs
import csv

#節点座標を抽出
temp=0
node_no = [];node_x = [];node_y = [];node_z = []
for point in node:
    temp += 1
    point_coord = rs.PointCoordinates(point)
    node_no.append(temp)
    node_x.append(float(point_coord[0]))
    node_y.append(float(point_coord[1]))
    node_z.append(float(point_coord[2]))
    
#梁部材の端部座標を抽出
beam_no = []; beam_start_No = []; beam_end_No = []; beam_category = []
beam_start_x = []; beam_start_y = []; beam_start_z = []
beam_end_x = []; beam_end_y = []; beam_end_z = []
layer_number = []; belong_height = []
temp = 0
layer.insert(0,0)

for i in beams:
    temp += 1
    #曲線の端点座標を抽出
    beam_start_point = rs.CurveStartPoint(i)
    beam_end_point = rs.CurveEndPoint(i)
    beam_no.append(temp)
    beam_start_x.append(beam_start_point[0])
    beam_start_y.append(beam_start_point[1])
    beam_start_z.append(beam_start_point[2])
    beam_end_x.append(beam_end_point[0])
    beam_end_y.append(beam_end_point[1])
    beam_end_z.append(beam_end_point[2])
        
    if float(beam_start_point[2]) == float(0):
        beam_category.append('BB')
    else:
        beam_category.append('')
        
    #所属層の判定
    temp3 = 1
    for j in layer: 
        if beam_end_point[2] <= j:
            layer_number.append(temp3)
            break
        temp3 += 1
    
    #始点の節点番号を抽出
    frag = 0
    for j in range(len(node)):
        if float(round(beam_start_point[0],1)) == float(round(node_x[j],1)) and float(round(beam_start_point[1],1)) == float(round(node_y[j],1)) and float(round(beam_start_point[2],1)) == float(round(node_z[j],1)):
            beam_start_No.append(node_no[j])
            frag = 1
    if frag == 0:
        beam_start_No.append("")
    
    frag = 0
    #終点の節点番号を抽出
    for j in range(len(node)):
        if float(round(beam_end_point[0],1)) == float(round(node_x[j],1)) and float(round(beam_end_point[1],1)) == float(round(node_y[j],1)) and float(round(beam_end_point[2],1)) == float(round(node_z[j],1)):
            beam_end_No.append(node_no[j])
            frag = 1
    if frag == 0:
        beam_end_No.append("")
            
print(len(beams),len(beam_no),len(beam_start_No),len(beam_end_No))
    
#柱部材の端部座標を抽出
column_no = [];column_start_No = []; column_end_No = []
column_start_x = []; column_start_y = []; column_start_z = []
column_end_x = []; column_end_y = []; column_end_z = []
layer_number2 = []; belong_height2 = []
temp = 0
for i in columns:
    temp += 1
    #曲線の端点座標を抽出
    column_start_point = rs.CurveStartPoint(i)
    column_end_point = rs.CurveEndPoint(i)
    column_no.append(temp)
    column_start_x.append(column_start_point[0])
    column_start_y.append(column_start_point[1])
    column_start_z.append(column_start_point[2])
    column_end_x.append(column_end_point[0])
    column_end_y.append(column_end_point[1])
    column_end_z.append(column_end_point[2])
    
    #所属層の判定
    belong_height2 = (column_start_z[temp-1]+column_end_z[temp-1])/2
    temp2 = 0
    for j in layer: 
        if belong_height2 < j:
            layer_number2.append(temp2)
            break
        temp2 += 1
    
    #始点の節点番号を抽出
    frag = 0
    for j in range(len(node)):
        if float(round(column_start_point[0],1)) == float(round(node_x[j],1)) and float(round(column_start_point[1],1)) == float(round(node_y[j],1)) and float(round(column_start_point[2],1)) == float(round(node_z[j],1)):
            column_start_No.append(node_no[j])
            frag = 1
    if frag == 0:
        column_start_No.append("")
    
    #終点の節点番号を抽出
    frag = 0
    for j in range(len(node)):
        if float(round(column_end_point[0],1) == float(round(node_x[j],1)) and float(round(column_end_point[1],1)) == float(round(node_y[j],1)) and float(round(column_end_point[2],1)) == float(round(node_z[j],1))):
            column_end_No.append(node_no[j])
            frag = 1
    if frag == 0:
        column_end_No.append("")
            
print(len(columns),len(column_no),len(column_start_No),len(column_end_No))
    
#csv出力
file_path = "E:\鹿島意匠\Initial_Section_Study\make_sample_model\output_node.csv"
with open(file_path, mode='w') as file:
    writer = csv.writer(file, lineterminator="\n")
    
    # データをCSVファイルに書き込む
    writer.writerow(['No','x','y','z','boundary'])
    for i in range(len(node)):
        writer.writerow([node_no[i],node_x[i],node_y[i],node_z[i],''])

file_path = "E:\鹿島意匠\Initial_Section_Study\make_sample_model\output_beams.csv"
with open(file_path, mode='w') as file:
    writer = csv.writer(file, lineterminator="\n")
    
    # データをCSVファイルに書き込む
    writer.writerow(['No.','i_point','j_point','phai','C','M','Q','category','story'])
    for i in range(len(beams)):
        writer.writerow([beam_no[i],beam_start_No[i],beam_end_No[i],1.2,35.8,53.7,38,beam_category[i],layer_number[i]])

file_path = "E:\鹿島意匠\Initial_Section_Study\make_sample_model\output_columns.csv"
with open(file_path, mode='w') as file:
    writer = csv.writer(file, lineterminator="\n")
    
    # データをCSVファイルに書き込む
    writer.writerow(['No.','i_point','j_point','story'])
    for i in range(len(columns)):
        writer.writerow([column_no[i],column_start_No[i],column_end_No[i],layer_number2[i]])
        
file_path = "E:\鹿島意匠\Initial_Section_Study\make_sample_model\output_layer.csv"
with open(file_path, mode='w') as file:
    writer = csv.writer(file, lineterminator="\n")
    
    # データをCSVファイルに書き込む
    writer.writerow(['Story','Story_height','omega_1','omega_2','floor_area'])
    print(layer)
    for i in range(len(layer)-1):
        temp = len(layer) - i-1
        layer_height = layer[len(layer)-i-1]-layer[len(layer)-i-2]
        writer.writerow([temp,layer_height,5.5,150,x_length*y_length])

#出力断面の読み込み
file_path = "E:\鹿島意匠\Initial_Section_Study\output_section_cost.csv"
record1 = [] ; record2 = []
with open(file_path, mode='r') as csvfile:
    # CSVリーダーオブジェクトを作成
    csv_reader = csv.reader(csvfile)
    # 行ごとに処理
    for row in csv_reader:
        # 行の内容を表示（例：各列の値を出力）
        if row[0] == '<selected_beam_section>':
            count = 1
        if count == 1:
            record1.append(row[0:5])
        if row[0] == '<selected_column_section>':
            count = 2
        if count == 2:
            record2.append(row[0:5])

beam_H=[];beam_B=[];beam_info=[]
column_H=[];column_t=[];column_info=[]
for i in range(2,len(record1)-1):
    temp=record1[i]
    if temp[1] == "[]":
        beam_H.append(0)
        beam_B.append(0)
        beam_info.append('')
    else:
        beam_H.append(float(temp[1])/1000)
        beam_B.append(float(temp[2])/1000)
        beam_info.append('H-'+str(temp[1])+'×'+str(temp[2]))

for i in range(2,len(record2)-1):
    temp2 = record2[i]
    column_H.append(float(temp2[1])/1000)
    column_t.append(float(temp2[2])/1000)
    column_info.append('□-'+str(temp2[1])+'×'+str(temp2[2]))
# ---------- end ghpython_script ----------
curve_middle_4 = CurveMiddle(Curve=column)
colour_picker_2 = ColourPicker(PickedColour=RGB(188, 227, 34))
set_intersection_3 = SetIntersection(SetA=point_3, SetB=point_3)
curve_middle_5 = CurveMiddle(Curve=beam)
end_points_3 = EndPoints(Curve=beam)  # -> Start, End
colour_picker_3 = ColourPicker(PickedColour=RGB(217, 137, 137))
line_11 = Line(StartPoint=curve_middle_5, EndPoint=end_points_3.Start)
line_12 = Line(StartPoint=curve_middle_5, EndPoint=end_points_3.End)
line_13 = Line([line_12, line_11])
curve_middle_6 = CurveMiddle(Curve=line_13)
closest_point = ClosestPoint(Point=curve_middle_6, Cloud=set_intersection_3)  # -> ClosestPoint, CPIndex, Distance
point_4 = Point(closest_point.ClosestPoint)
ghpython_script_2 = GhPythonScript(
    columns=flatten(column),
    beams=flatten(beam),
    node=flatten(set_intersection_3),
    layer=panel,
    x_length=list_item_3,
    y_length=list_item_4,
    Toggle=Button(),
    load_calc_line=line_13,
    belong_point=point_4,
    plane_point=point,
    outer_line=flatten(line_9),
    output_mode="design")  # -> out, beam_no, column_no, node_no, beam_H, beam_B, column_H, column_t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; inputs columns: list, beams: list, node: list, layer: list, load_calc_line: list, belong_point: list, plane_point: list, outer_line: list
# ---------- ghpython_script_2: Python ----------
__author__ = "fujishita"
__version__ = "2023.12.07"

import rhinoscriptsyntax as rs
import csv
import math

#節点座標を抽出
temp=0
node_no = [];node_x = [];node_y = [];node_z = []
for point in node:
    temp += 1
    point_coord = rs.PointCoordinates(point)
    node_no.append(temp)
    node_x.append(float(point_coord[0]))
    node_y.append(float(point_coord[1]))
    node_z.append(float(point_coord[2]))
    
#梁部材の端部座標を抽出
beam_no = []; beam_start_No = []; beam_end_No = []; beam_category = []
beam_start_x = []; beam_start_y = []; beam_start_z = []; beam_cond= []; beam_cond2=[]
beam_end_x = []; beam_end_y = []; beam_end_z = []
layer_number = []; belong_height = []
temp = 0;CC = []; MM = []; QQ = []; WW=[]
layer.insert(0,0)

#梁のエッジ座標の抽出
edge1_x = 0;edge2_x = x_length
edge1_y = 0;edge2_y = y_length

#柱の負担面積を計算
target_line_x=[];target_line_y=[];column_area=[]
for point in node:
    point_coord = rs.PointCoordinates(point)
    
    temp=0
    temp_line_x=[];temp_line_y=[]
    x_partlength=0;y_partlength=0
    for point2 in belong_point:
        point2_coord = rs.PointCoordinates(point2)
        if point_coord == point2_coord:
            if rs.CurveStartPoint(load_calc_line[temp])[0] == rs.CurveEndPoint(load_calc_line[temp])[0]: #Y方向梁の場合
                temp_line_y.append(load_calc_line[temp])
                y_partlength += rs.CurveLength(load_calc_line[temp])
            else:#X方向梁の場合
                temp_line_x.append(load_calc_line[temp])
                x_partlength += rs.CurveLength(load_calc_line[temp])
        temp+=1
    target_line_x.append(temp_line_x)
    target_line_y.append(temp_line_y)
    column_area.append(x_partlength*y_partlength)

omega1_floor = [13.5,13.5,9.4,8.4,8.5,8.5,8.5,8.5,8.8]
omega1_seismic = [12.8,12.8,8.4,7.4,7.5,7.5,7.5,7.5,7.8]
omega2_floor = [1,1,1,1,1,1,1,1,1]
omega2_seismic = [1,1,1,1,1,1,1,1,1]
omega1 = 5.5;count = 0;omega2 = 1.1
temp=0

edge_line_start_point=[]
edge_line_end_point=[]
#外周にある線分の抽出
for i in outer_line:
    edge_line_start_point.append(rs.CurveStartPoint(i))
    edge_line_end_point.append(rs.CurveEndPoint(i))

#外周大梁の判別
edge_judge = []
for i in beams:
    frag=0
    beam_start_point = rs.CurveStartPoint(i)
    beam_end_point = rs.CurveEndPoint(i)
    
    for j in range(len(edge_line_start_point)):
        if (beam_start_point[0], beam_start_point[1]) == (edge_line_start_point[j][0], edge_line_start_point[j][1]) and (beam_end_point[0], beam_end_point[1]) == (edge_line_end_point[j][0], edge_line_end_point[j][1]) or (beam_start_point[0], beam_start_point[1]) == (edge_line_end_point[j][0], edge_line_end_point[j][1]) and (beam_end_point[0], beam_end_point[1]) == (edge_line_start_point[j][0], edge_line_start_point[j][1]):
            frag = 1
    if frag == 1:
        edge_judge.append("e")
    else:
        edge_judge.append("n")    

for i in beams:
    temp += 1
    #曲線の端点座標を抽出
    beam_start_point = rs.CurveStartPoint(i)
    beam_end_point = rs.CurveEndPoint(i)
    beam_no.append(temp)
    beam_start_x.append(beam_start_point[0])
    beam_start_y.append(beam_start_point[1])
    beam_start_z.append(beam_start_point[2])
    beam_end_x.append(beam_end_point[0])
    beam_end_y.append(beam_end_point[1])
    beam_end_z.append(beam_end_point[2])
    
    #梁の端点座標に対応するベース節点を探索
    temp5= 0
    ver_length = 0
    h_length = 0
    for j in node:
        if round(rs.PointCoordinates(j)[0],1) == round(beam_start_point[0],1) and round(rs.PointCoordinates(j)[1],1) == round(beam_start_point[1],1) and round(rs.PointCoordinates(j)[2],1) == round(beam_start_point[2],1):
            if beam_start_point[1] == beam_end_point[1]:#X方向梁の場合Y方向にとりつく梁の長さに着目
                temp_length=[]
                for k in target_line_y[temp5]:
                    ver_length += rs.CurveLength(k)
                    temp_length.append(rs.CurveLength(k))
                    
                if rs.CurveLength(i)/2 >= ver_length:#台形分布を考慮する場合

                    if edge_judge[temp-1] == "e":#外周梁の場合
                        if round(beam_start_point[2],1) == 0:#最下層の場合
                            area = rs.CurveLength(i) * ver_length - ver_length * ver_length * 1/2 *2

                            CC.append(float(omega1_floor[0]*ver_length/12/rs.CurveLength(i)*(rs.CurveLength(i)**3-2*(ver_length)**2*rs.CurveLength(i)+(ver_length)**3)+1/12*rs.CurveLength(i)**2*omega2_floor[0]*layer[1]/2))
                            MM.append(float((omega1_floor[0]*ver_length)/24*(3*rs.CurveLength(i)**2-4*(ver_length)**2)+1/8*rs.CurveLength(i)**2*omega2_floor[0]*layer[1]/2))
                            QQ.append(float((omega1_floor[0]*ver_length)*(rs.CurveLength(i)-ver_length)/2+1/2*rs.CurveLength(i)*omega2_floor[0]*layer[1]*rs.CurveLength(i)/2))
                        elif round(beam_start_point[2],1) == round(layer[len(layer)-1],1):#最上層の場
                            area = rs.CurveLength(i) * ver_length - ver_length * ver_length * 1/2 *2
                            CC.append(float((omega1_floor[len(layer)-1]*ver_length)/12/rs.CurveLength(i)*(rs.CurveLength(i)**3-2*(ver_length)**2*rs.CurveLength(i)+(ver_length)**3)+1/12*rs.CurveLength(i)**2*omega2_floor[len(layer)-1]*(layer[len(layer)-1]-layer[len(layer)-2])/2))
                            MM.append(float((omega1_floor[len(layer)-1]*ver_length)/24*(3*rs.CurveLength(i)**2-4*(ver_length)**2)+1/8*rs.CurveLength(i)**2*omega2_floor[len(layer)-1]*(layer[len(layer)-1]-layer[len(layer)-2])/2))
                            QQ.append(float((omega1_floor[len(layer)-1]*ver_length)*(rs.CurveLength(i)-ver_length)/2+1/2*rs.CurveLength(i)*omega2_floor[len(layer)-1]*(layer[len(layer)-1]-layer[len(layer)-2])/2))
                        else:#それ以外の場合
                            for l in range(len(layer)):
                                if round(beam_start_point[2],1) == round(layer[l],1):
                                    print(l,layer[l+1],layer[l],layer[l-1])
                                    area = rs.CurveLength(i) * ver_length - ver_length * ver_length * 1/2 *2
                                    CC.append(float((omega1_floor[l]*ver_length)/12/rs.CurveLength(i)*(rs.CurveLength(i)**3-2*(ver_length)**2*rs.CurveLength(i)+(ver_length)**3)+1/12*rs.CurveLength(i)**2*omega2_floor[l]*((layer[l+1]-layer[l])/2+(layer[l]-layer[l-1])/2)))
                                    MM.append(float((omega1_floor[l]*ver_length)/24*(3*rs.CurveLength(i)**2-4*(ver_length)**2)+1/8*rs.CurveLength(i)**2*omega2_floor[l]*((layer[l+1]-layer[l])/2+(layer[l]-layer[l-1])/2)))
                                    QQ.append(float((omega1_floor[l]*ver_length)*(rs.CurveLength(i)-ver_length)/2)+1/2*rs.CurveLength(i)*omega2_floor[l]*((layer[l+1]-layer[l])/2+(layer[l]-layer[l-1])/2))
                            
                    else:
                        #フロア数のカウント
                        temp4 = 0
                        for l in range(len(layer)):
                            if round(beam_start_point[2],1) == round(layer[l],1):
                                break
                            else:
                                temp4 += 1
                        
                        temp_CC=0;temp_MM=0;temp_QQ=0
                        for l in temp_length:
                            temp_CC += float((omega1_floor[temp4]*l)/12/rs.CurveLength(i)*(rs.CurveLength(i)**3-2*(l)**2*rs.CurveLength(i)+(l)**3))
                            temp_MM += float((omega1_floor[temp4]*l)/24*(3*rs.CurveLength(i)**2-4*(l)**2))
                            temp_QQ += float((omega1_floor[temp4]*l)*(rs.CurveLength(i)-l)/2)
                        
                        area = rs.CurveLength(i) * ver_length - ver_length * ver_length * 1/2 *2
                        CC.append(temp_CC)
                        MM.append(temp_MM)
                        QQ.append(temp_QQ)
                    
                else:#3角形分布を考慮する場合
                    if edge_judge[temp-1] == "e":#外周梁の場合
                        if round(beam_start_point[2],1) == 0:#最下層の場合
                            area = ver_length * ver_length *1/2 *2
                            CC.append(float((omega1_floor[0]*rs.CurveLength(i)/2)*rs.CurveLength(i)**2*5/96+1/12*rs.CurveLength(i)**2*omega2_floor[0]*layer[1]/2))
                            MM.append(float((omega1_floor[0]*rs.CurveLength(i)/2)*rs.CurveLength(i)**2/12+1/8*rs.CurveLength(i)**2*omega2_floor[0]*layer[1]/2))
                            QQ.append(float((omega1_floor[0]*rs.CurveLength(i)/2)*rs.CurveLength(i)/4+1/2*rs.CurveLength(i)*omega2_floor[0]*layer[1]/2))
                        elif round(beam_start_point[2],1) == round(layer[len(layer)-1],1):#最上層の場合
                            area = ver_length * ver_length *1/2 *2
                            CC.append(float((omega1_floor[len(layer)-1]*rs.CurveLength(i)/2)*rs.CurveLength(i)**2*5/96+1/12*rs.CurveLength(i)**2*omega2_floor[len(layer)-1]* (layer[len(layer)-1]-layer[len(layer)-2])/2))
                            MM.append(float((omega1_floor[len(layer)-1]*rs.CurveLength(i)/2)*rs.CurveLength(i)**2/12+1/8*rs.CurveLength(i)**2*omega2_floor[len(layer)-1]* (layer[len(layer)-1]-layer[len(layer)-2])/2))
                            QQ.append(float((omega1_floor[len(layer)-1]*rs.CurveLength(i)/2)*rs.CurveLength(i)/4+1/2*rs.CurveLength(i)*omega2_floor[len(layer)-1]* (layer[len(layer)-1]-layer[len(layer)-2])/2))
                        else:#それ以外の場合
                            for l in range(len(layer)):
                                if round(beam_start_point[2],1) == round(layer[l],1):
                                    print(l,layer[l+1],layer[l],layer[l-1])
                                    area = ver_length * ver_length * 1/2 *2
                                    CC.append(float((omega1_floor[l]*rs.CurveLength(i)/2+omega2_floor[l]*((layer[l+1]-layer[l])/2+(layer[l]-layer[l-1])/2))*rs.CurveLength(i)**2*5/96))
                                    MM.append(float((omega1_floor[l]*rs.CurveLength(i)/2+omega2_floor[l]* ((layer[l+1]-layer[l])/2+(layer[l]-layer[l-1])/2))*rs.CurveLength(i)**2/12))
                                    QQ.append(float((omega1_floor[l]*rs.CurveLength(i)/2+omega2_floor[l]* ((layer[l+1]-layer[l])/2+(layer[l]-layer[l-1])/2))*rs.CurveLength(i)/4))
                                
                    else:
                       #フロア数のカウント
                        temp4 = 0
                        for l in range(len(layer)):
                            if round(beam_start_point[2],1) == round(layer[l],1):
                                break
                            else:
                                temp4 += 1
                                                            
                                
                        area = ver_length * ver_length *1/2 *2
                        CC.append(float((omega1_floor[temp4]*rs.CurveLength(i)/2)*rs.CurveLength(i)**2*5/96*2))
                        MM.append(float((omega1_floor[temp4]*rs.CurveLength(i)/2)*rs.CurveLength(i)**2/12*2))
                        QQ.append(float((omega1_floor[temp4]*rs.CurveLength(i)/2*rs.CurveLength(i)/4*2)))                 

            else:#Y方向梁の場合X方向にとりつく梁の長さに着目
                temp_length=[]
                for k in target_line_x[temp5]:
                    ver_length += rs.CurveLength(k)
                    temp_length.append(rs.CurveLength(k))
                if rs.CurveLength(i)/2 >= ver_length:
                    if edge_judge[temp-1] == "e":#外周梁の場合
                        if round(beam_start_point[2],1) == 0:#最下層の場合
                            area = rs.CurveLength(i) * ver_length - ver_length * ver_length * 1/2 *2
                            CC.append(float((omega1_floor[0]*ver_length)/12/rs.CurveLength(i)*(rs.CurveLength(i)**3-2*(ver_length)**2*rs.CurveLength(i)+(ver_length)**3)+1/12*rs.CurveLength(i)**2*omega2_floor[0]*layer[1]/2))
                            MM.append(float((omega1_floor[0]*ver_length)/24*(3*rs.CurveLength(i)**2-4*(ver_length)**2)+1/8*rs.CurveLength(i)**2*omega2_floor[0]*layer[1]/2))
                            QQ.append(float((omega1_floor[0]*ver_length)*(rs.CurveLength(i)-ver_length)/2+1/2*rs.CurveLength(i)*omega2_floor[0]*layer[1]/2))
                        elif round(beam_start_point[2],1) == round(layer[len(layer)-1],1):#最上層の場合
                            area = rs.CurveLength(i) * ver_length - ver_length * ver_length * 1/2 *2
                            CC.append(float((omega1_floor[len(layer)-1]*ver_length)/12/rs.CurveLength(i)*(rs.CurveLength(i)**3-2*(ver_length)**2*rs.CurveLength(i)+(ver_length)**3)+1/12*rs.CurveLength(i)**2*omega2_floor[len(layer)-1]*(layer[len(layer)-1]-layer[len(layer)-2])/2))
                            MM.append(float((omega1_floor[len(layer)-1]*ver_length)/24*(3*rs.CurveLength(i)**2-4*(ver_length)**2)+1/8*rs.CurveLength(i)**2*omega2_floor[len(layer)-1]*(layer[len(layer)-1]-layer[len(layer)-2])/2))
                            QQ.append(float((omega1_floor[len(layer)-1]*ver_length)*(rs.CurveLength(i)-ver_length)/2+1/2*rs.CurveLength(i)*omega2_floor[len(layer)-1]*(layer[len(layer)-1]-layer[len(layer)-2])/2))
                        else:#それ以外の場合
                            for l in range(len(layer)):
                                if round(beam_start_point[2],1) == round(layer[l],1):
                                    print(l,layer[l+1],layer[l],layer[l-1])
                                    area = rs.CurveLength(i) * ver_length - ver_length * ver_length * 1/2 *2
                                    CC.append(float((omega1_floor[l]*ver_length)/12/rs.CurveLength(i)*(rs.CurveLength(i)**3-2*(ver_length)**2*rs.CurveLength(i)+(ver_length)**3)+1/12*rs.CurveLength(i)**2*omega2_floor[l]*((layer[l+1]-layer[l])/2+(layer[l]-layer[l-1])/2)))
                                    MM.append(float((omega1_floor[l]*ver_length)/24*(3*rs.CurveLength(i)**2-4*(ver_length)**2)+1/8*rs.CurveLength(i)**2*omega2_floor[l]*((layer[l+1]-layer[l])/2+(layer[l]-layer[l-1])/2)))
                                    QQ.append(float((omega1_floor[l]*ver_length)*(rs.CurveLength(i)-ver_length)/2+1/2*rs.CurveLength(i)*omega2_floor[l]*((layer[l+1]-layer[l])/2+(layer[l]-layer[l-1])/2)))
                    else:
                        #フロア数のカウント
                        temp4 = 0
                        for l in range(len(layer)):
                            if round(beam_start_point[2],1) == round(layer[l],1):
                                break
                            else:
                                temp4 += 1

                        temp_CC=0;temp_MM=0;temp_QQ=0
                        for l in temp_length:
                            temp_CC += float((omega1_floor[temp4]*l)/12/rs.CurveLength(i)*(rs.CurveLength(i)**3-2*(l)**2*rs.CurveLength(i)+(l)**3))
                            temp_MM += float((omega1_floor[temp4]*l)/24*(3*rs.CurveLength(i)**2-4*(l)**2))
                            temp_QQ += float((omega1_floor[temp4]*l)*(rs.CurveLength(i)-l)/2)
                        
                        area = rs.CurveLength(i) * ver_length - ver_length * ver_length * 1/2 *2
                        CC.append(temp_CC)
                        MM.append(temp_MM)
                        QQ.append(temp_QQ)
                                    
                else:
                    #print(beam_start_point)
                    if edge_judge[temp-1] == "e":#外周梁の場合
                        if round(beam_start_point[2],1) == 0:#最下層の場合
                            area = ver_length * ver_length *1/2 *2
                            CC.append(float((omega1_floor[0]*rs.CurveLength(i)/2)*rs.CurveLength(i)**2*5/96+1/12*rs.CurveLength(i)**2*omega2_floor[0]*layer[1]/2))
                            MM.append(float((omega1_floor[0]*rs.CurveLength(i)/2)*rs.CurveLength(i)**2/12+1/8*rs.CurveLength(i)**2*omega2_floor[0]*layer[1]/2))
                            QQ.append(float((omega1_floor[0]*rs.CurveLength(i)/2)*rs.CurveLength(i)/4+1/2*rs.CurveLength(i)*omega2_floor[0]*layer[1]/2))
                        elif round(beam_start_point[2],1) == round(layer[len(layer)-1],1):#最上層の場合
                            area = ver_length * ver_length *1/2 *2
                            CC.append(float((omega1_floor[len(layer)-1]*rs.CurveLength(i)/2)*rs.CurveLength(i)**2*5/96+1/12*rs.CurveLength(i)**2*omega2_floor[len(layer)-1]* (layer[len(layer)-1]-layer[len(layer)-2])/2))
                            MM.append(float((omega1_floor[len(layer)-1]*rs.CurveLength(i)/2)*rs.CurveLength(i)**2/12+1/8*rs.CurveLength(i)**2*omega2_floor[len(layer)-1]* (layer[len(layer)-1]-layer[len(layer)-2])/2))
                            QQ.append(float((omega1_floor[len(layer)-1]*rs.CurveLength(i)/2)*rs.CurveLength(i)/4+1/2*rs.CurveLength(i)*omega2_floor[len(layer)-1]* (layer[len(layer)-1]-layer[len(layer)-2])/2))
                        else:#それ以外の場合
                            for l in range(len(layer)):
                                if round(beam_start_point[2],1) == round(layer[l],1):
                                    print(l,layer[l+1],layer[l],layer[l-1])
                                    area = rs.CurveLength(i) * ver_length - ver_length * ver_length * 1/2 *2
                                    CC.append(float((omega1_floor[l]*rs.CurveLength(i)/2)*rs.CurveLength(i)**2*5/96+1/12*rs.CurveLength(i)**2*omega2_floor[l]*((layer[l+1]-layer[l])/2+(layer[l]-layer[l-1])/2)))
                                    MM.append(float((omega1_floor[l]*rs.CurveLength(i)/2)*rs.CurveLength(i)**2/12+1/8*rs.CurveLength(i)**2*omega2_floor[l]* ((layer[l+1]-layer[l])/2+(layer[l]-layer[l-1])/2)))
                                    QQ.append(float((omega1_floor[l]*rs.CurveLength(i)/2)*rs.CurveLength(i)/4)+1/2*rs.CurveLength(i)*omega2_floor[l]* ((layer[l+1]-layer[l])/2+(layer[l]-layer[l-1])/2))
                    else:
                        #フロア数のカウント
                        temp4 = 0
                        for l in range(len(layer)):
                            if round(beam_start_point[2],1) == round(layer[l],1):
                                break
                            else:
                                temp4 += 1
                        area = ver_length * ver_length *1/2 *2
                        CC.append(float((omega1_floor[temp4]*rs.CurveLength(i)/2)*rs.CurveLength(i)**2*5/96*2))
                        MM.append(float((omega1_floor[temp4]*rs.CurveLength(i)/2)*rs.CurveLength(i)**2/12*2))
                        QQ.append(float((omega1_floor[temp4]*rs.CurveLength(i)/2*rs.CurveLength(i)/4*2)))
                       
                        
            count+=1
        temp5 += 1
    
    #梁の剛性増大率の判定
    #梁がエッジの場合1.2or1.3
    
    if (beam_start_point[0] == edge1_x and beam_end_point[0] == edge1_x) or (beam_start_point[0] == edge2_x and beam_end_point[0] == edge2_x) or (beam_start_point[1] == edge1_y and beam_end_point[1] == edge1_y) or (beam_start_point[1] == edge2_y and beam_end_point[1] == edge2_y):
        beam_cond.append(1.2)
        beam_cond2.append(1.3)
    #両側にスラブが取りつく場合1.4or1.6
    else:
        beam_cond.append(1.4)
        beam_cond2.append(1.6)
        
    if float(beam_start_point[2]) == float(0):
        beam_category.append('BB')
    else:
        beam_category.append('')
        
    #所属層の判定
    temp3 = 1
    for j in layer: 
        if beam_end_point[2] <= j:
            layer_number.append(temp3)
            break
        temp3 += 1
    
    #始点の節点番号を抽出
    frag = 0
    for j in range(len(node)):
        if float(round(beam_start_point[0],1)) == float(round(node_x[j],1)) and float(round(beam_start_point[1],1)) == float(round(node_y[j],1)) and float(round(beam_start_point[2],1)) == float(round(node_z[j],1)):
            beam_start_No.append(node_no[j])
            frag = 1
    if frag == 0:
        beam_start_No.append("")
    
    frag = 0
    #終点の節点番号を抽出
    for j in range(len(node)):
        if float(round(beam_end_point[0],1)) == float(round(node_x[j],1)) and float(round(beam_end_point[1],1)) == float(round(node_y[j],1)) and float(round(beam_end_point[2],1)) == float(round(node_z[j],1)):
            beam_end_No.append(node_no[j])
            frag = 1
    if frag == 0:
        beam_end_No.append("")


#柱部材の端部座標を抽出
column_no = [];column_start_No = []; column_end_No = []
column_start_x = []; column_start_y = []; column_start_z = []
column_end_x = []; column_end_y = []; column_end_z = []
layer_number2 = []; belong_height2 = []
column_load_area=[]
temp = 0
for i in columns:
    temp += 1
    #曲線の端点座標を抽出
    column_start_point = rs.CurveStartPoint(i)
    column_end_point = rs.CurveEndPoint(i)
    
    #各柱の負担面積の呼び出し
    temp3=0
    for j in node:
        if column_start_point[2] > column_end_point[2]:#スタートポイントの方が上にある場合
            if rs.PointCoordinates(j)[0] == column_start_point[0] and rs.PointCoordinates(j)[1] == column_start_point[1] and rs.PointCoordinates(j)[2] == column_start_point[2]:
                column_load_area.append(column_area[temp3])
        else:
            if rs.PointCoordinates(j)[0] == column_end_point[0] and rs.PointCoordinates(j)[1] == column_end_point[1] and rs.PointCoordinates(j)[2] == column_end_point[2]:
                column_load_area.append(column_area[temp3])
        temp3 += 1
    
    column_no.append(temp)
    column_start_x.append(column_start_point[0])
    column_start_y.append(column_start_point[1])
    column_start_z.append(column_start_point[2])
    column_end_x.append(column_end_point[0])
    column_end_y.append(column_end_point[1])
    column_end_z.append(column_end_point[2])
    
    #所属層の判定
    belong_height2 = (column_start_z[temp-1]+column_end_z[temp-1])/2
    temp2 = 0
    for j in layer: 
        if belong_height2 < j:
            layer_number2.append(temp2)
            break
        temp2 += 1
    
    #始点の節点番号を抽出
    frag = 0
    for j in range(len(node)):
        if float(round(column_start_point[0],1)) == float(round(node_x[j],1)) and float(round(column_start_point[1],1)) == float(round(node_y[j],1)) and float(round(column_start_point[2],1)) == float(round(node_z[j],1)):
            column_start_No.append(node_no[j])
            frag = 1
    if frag == 0:
        column_start_No.append("")
    
    #終点の節点番号を抽出
    frag = 0
    for j in range(len(node)):
        if float(round(column_end_point[0],1) == float(round(node_x[j],1)) and float(round(column_end_point[1],1)) == float(round(node_y[j],1)) and float(round(column_end_point[2],1)) == float(round(node_z[j],1))):
            column_end_No.append(node_no[j])
            frag = 1
    if frag == 0:
        column_end_No.append("")
    
#csv出力
file_path = "input_nodes.csv"
with open(file_path, mode='w') as file:
    writer = csv.writer(file, lineterminator="\n")
    
    # データをCSVファイルに書き込む
    writer.writerow(['no','x','y','z','boundary'])
    for i in range(len(node)):
        writer.writerow([node_no[i],node_x[i],node_y[i],node_z[i],''])

file_path = "input_beams.csv"
with open(file_path, mode='w') as file:
    writer = csv.writer(file, lineterminator="\n")
    
    # データをCSVファイルに書き込む
    writer.writerow(['no','i_point','j_point','phi','phi2','C','M','Q','category','story','boundary_i','boundary_j'])
    for i in range(len(beams)):
        writer.writerow([beam_no[i],beam_start_No[i],beam_end_No[i],beam_cond[i],beam_cond2[i],CC[i],MM[i],QQ[i],beam_category[i],layer_number[i],'fix','fix'])

file_path = "input_columns.csv"
with open(file_path, mode='w') as file:
    writer = csv.writer(file, lineterminator="\n")
    
    # データをCSVファイルに書き込む
    writer.writerow(['no','i_point','j_point','story','load_area'])
    for i in range(len(columns)):
        writer.writerow([column_no[i],column_start_No[i],column_end_No[i],layer_number2[i],column_load_area[i]])
        
file_path = "input_layers.csv"
with open(file_path, mode='w') as file:
    writer = csv.writer(file, lineterminator="\n")
    
    # データをCSVファイルに書き込む
    writer.writerow(['story','story_height','omega_1_floor','omega_2_floor','omega_1_seismic','omega_2_seismic','floor_area','outerwall_length'])

    for i in range(len(layer)-1):
        temp = len(layer) - i-1
        layer_height = layer[len(layer)-i-1]-layer[len(layer)-i-2]
        writer.writerow([temp,layer_height,omega1_floor[i],omega2_floor[i],omega1_seismic[i],omega2_seismic[i],x_length*y_length,(x_length+y_length)*2])

#出力断面の読み込み
file_path = "..\output_section_"+str(output_mode)+".csv"
record1 = [] ; record2 = []
with open(file_path, mode='r') as csvfile:
    # CSVリーダーオブジェクトを作成
    csv_reader = csv.reader(csvfile)
    # 行ごとに処理
    for row in csv_reader:
        # 行の内容を表示（例：各列の値を出力）
        if row[0] == '<selected_beam_section>':
            count = 1
        if count == 1:
            record1.append(row[0:9])
        if row[0] == '<selected_column_section>':
            count = 2
        if count == 2:
            record2.append(row[0:5])

beam_H=[];beam_B=[];beam_info=[]
column_H=[];column_t=[];column_info=[]
for i in range(2,len(record1)-1):
    temp=record1[i]
    if temp[1] == "[]":
        beam_H.append(0)
        beam_B.append(0)
        beam_info.append('')
    else:
        ttt1 = int(float(temp[1]))
        ttt2 = int(float(temp[2]))
        ttt3 = int(float(temp[8]))
        beam_H.append(float(temp[1])/1000)
        beam_B.append(float(temp[2])/1000)
        beam_info.append('H-'+str(ttt1)+'×'+str(ttt2)+'\n(F'+str(ttt3)+')')

for i in range(2,len(record2)):
    temp2 = record2[i]
    ttt1 = int(float(temp2[1]))
    ttt2 = int(float(temp2[2]))
    column_H.append(float(temp2[1])/1000)
    column_t.append(float(temp2[2])/1000)
    column_info.append('□-'+str(ttt1)+'×'+str(ttt2))
# ---------- end ghpython_script_2 ----------
text_tag_3d = TextTag3D(Location=curve_middle, Text=ghpython_script_2.beam_no, Size="0.5", Colour=colour_picker, Justification=7)
text_tag_3d_2 = TextTag3D(Location=curve_middle_3, Text=ghpython_script_2.column_no, Size="0.5", Colour=colour_picker_2, Justification=7)
text_tag_3d_3 = TextTag3D(Location=merge_2, Text=ghpython_script_2.node_no, Size="0.5", Colour=colour_picker_3, Justification=7)
cluster = Cluster(
    G_2=curve_middle_4,
    text=ghpython_script_2.column_info,
    x_2=ghpython_script_2.layer_number2,
    text_2=ghpython_script_2.beam_info,
    O=line_6,
    C=list_length_7,
    location=curve_middle_2,
    text_3=ghpython_script_2.beam_info,
    G=curve_middle_2,
    curve=beam,
    radius=ghpython_script_2.beam_H,
    curve_2=column,
    radius_2=ghpython_script_2.column_H,
    x=ghpython_script_2.layer_number,
    location_2=curve_middle_4,
    text_4=ghpython_script_2.column_info)

# ==== cluster Cluster
x = ClusterInput()
panel = Panel("8")
expression = Expression(x=x, y="30", Expression="y*x-30")
C = ClusterInput()
O = ClusterInput()
series = Series(Start="30", Step="30", Count=C)
vec = VectorXYZ(XComponent=expression, YComponent=0, ZComponent=0)  # -> Vector, Length
G = ClusterInput()
group = Group(Objects=O)
X = UnitX(Factor=series)
move = Move(Geometry=G, Motion=vec.Vector)  # -> Geometry, Transform
move_2 = Move(Geometry=group, Motion=X)  # -> Geometry, Transform
x_2 = ClusterInput()
expression_2 = Expression(x=x_2, y="30", Expression="y*x")
vec_2 = VectorXYZ(XComponent=expression_2, YComponent=0, ZComponent=0)  # -> Vector, Length
G_2 = ClusterInput()
move_3 = Move(Geometry=G_2, Motion=vec_2.Vector)  # -> Geometry, Transform
colour_picker = ColourPicker(PickedColour=RGB(0, 0, 0))
colour_picker_2 = ColourPicker(PickedColour=RGB(0, 0, 0))
colour_picker_3 = ColourPicker(PickedColour=RGB(245, 218, 47))
colour_picker_4 = ColourPicker(PickedColour=RGB(0, 0, 0))
text = ClusterInput()
text_2 = ClusterInput()
location = ClusterInput()
text_3 = ClusterInput()
curve = ClusterInput()
radius = ClusterInput()
curve_2 = ClusterInput()
radius_2 = ClusterInput()
text_tag_3d = TextTag3D(Location=move_3.Geometry, Text=text, Size="0.4", Colour=colour_picker, Justification="1")
location_2 = ClusterInput()
text_4 = ClusterInput()
text_tag_3d_2 = TextTag3D(Location=move.Geometry, Text=text_2, Size="0.4", Colour=colour_picker_2, Justification="7")
text_tag_3d_3 = TextTag3D(Location=location, Text=text_3, Size="0.4", Colour=colour_picker_3, Justification="3")
pipe = Pipe(Curve=curve, Radius=radius, Caps=0)
pipe_2 = Pipe(Curve=curve_2, Radius=radius_2, Caps=0)
text_tag_3d_4 = TextTag3D(Location=location_2, Text=text_4, Size="0.4", Colour=colour_picker_4, Justification="3")
